# Grasshopper definition mock.gh (Grasshopper 1.0.7)

python = GhPythonScript()  # -> out, dll
# ---------- python: Python ----------
__author__ = "roboticplus"
__version__ = "2023.08.22"

import rhinoscriptsyntax as rs
import clr
import System.IO as io

io.Directory.SetCurrentDirectory(rs.DocumentPath())

clr.AddReferenceToFileAndPath("./dll/NewtonSoft.Json.dll")
# ---------- end python ----------
jsonsetting = PolyWithHoles(dll=python.dll)  # -> out, settings
# ---------- jsonsetting: Python ----------
ghenv.Component.NickName = "JsonSetting"

__author__ = "roboticplus"
__version__ = "2023.08.22"

import Newtonsoft.Json as nj

settings = nj.JsonSerializerSettings()
settings.TypeNameHandling = nj.TypeNameHandling.Auto
settings.ConstructorHandling = nj.ConstructorHandling.AllowNonPublicDefaultConstructor
settings.PreserveReferencesHandling = nj.PreserveReferencesHandling.Objects
settings.ObjectCreationHandling = nj.ObjectCreationHandling.Auto
# ---------- end jsonsetting ----------

crv = Curve(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)
crv_2 = Curve(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)
merge = Merge(Data1=crv, Data2=crv_2)
polywithholes = PolyWithHoles(curves=merge, name="ss_test", settings=jsonsetting.settings, write=Button())  # -> out, data; inputs curves: list of Curve, write: Boolean
# ---------- polywithholes: Python ----------
ghenv.Component.NickName = "PolyWithHoles"

__author__ = "roboticplus"
__version__ = "2023.08.22"

import Newtonsoft.Json as nj
import Rhino.Geometry as rg
import System.Collections.Generic.List as List

data = nj.JsonConvert.SerializeObject(List[rg.Curve](curves), nj.Formatting.None, settings)

if write:
    with open(name + ".json", "w") as file:
        file.write(data)
# ---------- end polywithholes ----------

brep = Brep(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)
mesh = Mesh(brep)
polywithholes_2 = PolyWithHoles(mesh=mesh, name="obb_test", settings=jsonsetting.settings, write=Button())  # -> out, data; inputs mesh: Mesh, write: Boolean
# ---------- polywithholes_2: Python ----------
ghenv.Component.NickName = "PolyWithHoles"

__author__ = "roboticplus"
__version__ = "2023.08.22"

import Newtonsoft.Json as nj
import Rhino.Geometry as rg
import System.Collections.Generic.List as List

data = nj.JsonConvert.SerializeObject(mesh, nj.Formatting.None, settings)

if write:
    with open(name + ".json", "w") as file:
        file.write(data)
# ---------- end polywithholes_2 ----------
