# Grasshopper definition CgalTest.gh (Grasshopper 1.0.7)

dll = ImportDll(asm="CgalUtilWrapper.dll")  # -> dll
# ---------- dll: Python ----------
ghenv.Component.Name = "Import Dll"
ghenv.Component.NickName = "Dll"

import rhinoscriptsyntax as rs
import System.IO as io
import clr

cwd = io.Path.GetDirectoryName(ghenv.Component.OnPingDocument().FilePath) + "/spec/"
io.Directory.SetCurrentDirectory(cwd)

thisDir = rs.DocumentPath();
binDir = io.Directory.GetParent(thisDir).Parent.FullName + "\\x64\\Debug\\"
asmPath = binDir + asm
dll = asmPath

clr.AddReferenceToFileAndPath(asmPath)
# ---------- end dll ----------
pt = Point([Point(-22.5550093, 8.399851186, 0), Point(-14.31567612, 8.399851186, 0), Point(-7.188025161, 0.1367000313, 0), Point(-17.46859038, 2.638174929, 0), Point(-23.60261882, -1.734457775, 0)])
pt_2 = Point([Point(15.77016182, 26.34169641, 0), Point(28.73406013, 25.95988025, 0), Point(38.01243837, 2.363923694, 0), Point(13.92649047, 8.82681855, 0)])
pt_3 = Point([Point(-4.481285155, -13.67700759, 0), Point(0.9299260421, 8.128704496, 0), Point(23.33280181, -19.27715932, 0)])
pt_4 = Point([Point(27.62536555, 45.71307328, 0), Point(-27.52179238, 42.37614334, 0), Point(-15.99631632, 27.62071744, 0), Point(-47.76029403, 13.48688379, 0), Point(-15.75472365, -44.73529084, 0), Point(13.38279291, -26.95612308, 0), Point(51.51075879, -28.75315272, 0), Point(59.31356148, 12.82593407, 0), Point(36.75801591, 21.65205214, 0)])
pline = PolyLine(Vertices=pt, Closed=True)
pline_2 = PolyLine(Vertices=pt_3, Closed=True)
pline_3 = PolyLine(Vertices=pt_2, Closed=True)
pline_4 = PolyLine(Vertices=pt_4, Closed=True)
merge = Merge(Data1=pline_3, Data2=pline, Data3=pline_2)  # -> flatten(Result)
c_script = CSharpScript(path="spec/StraightSkeleton.py", refresh=Button())  # -> out, A; inputs path: String, refresh: Boolean
# ---------- c_script: C# usings ----------
using System.IO;
# ---------- c_script: C# ----------
    string thisDir = Path.GetDirectoryName(this.Component.OnPingDocument().FilePath);
        string file = File.ReadAllText(thisDir + @"\" + path);
    A = file;
# ---------- end c_script ----------
straightskeletontest = Instance(Code=c_script.A, Dll=dll, Outer=pline_4, Inner=merge)  # -> Out, StraightSkeleton

crv = Curve(straightskeletontest.StraightSkeleton)
merge_2 = Merge(Data1=pline_4, Data2=merge)  # -> flatten(Result)
divlength = DivideLength(Curve=crv, Length=Slider(4.2, range=0.1..100))  # -> flatten(Points), Tangents, Parameters
python = GhPythonScript(point=divlength.Points, curves=merge_2)  # -> out, radius; inputs point: Point3d, curves: list of Curve
# ---------- python: Python ----------
import Rhino.Geometry as rg

radius = float.MaxValue

for crv in curves:
    ok, t = crv.ClosestPoint(point)
    if not ok: continue
    dist = point.DistanceTo(crv.PointAt(t))
    if dist < radius:
        radius = dist
# ---------- end python ----------
cir = Circle(Plane=divlength.Points, Radius=python.radius)

preview = CustomPreview(Geometry=cir, Material=ColourSwatch(SwatchColor=RGB(143, 127, 127)))
preview_2 = CustomPreview(Geometry=pline_4, Material=ColourSwatch(SwatchColor=RGB(251, 255, 0)))
preview_3 = CustomPreview(Geometry=merge, Material=ColourSwatch(SwatchColor=RGB(0, 255, 238)))
